# Grasshopper definition grasshopper-experimenting.gh (Grasshopper 1.0.7)

rec = Rectangle({Plane=PlaneXY(25, 25, 0), Size=Domain2(u=-25..25, v=-25..25)})
srf = Surface(<surface referenced from the Rhino model>)
popgeo = PopulateGeometry(Geometry=srf, Count=100, Seed=1)
pop2d = Populate2D(Region=rec, Count=Slider(125, range=0..1000), Seed=1)
voronoi = Voronoi(Boundary=srf, BruteForceOverride=False)
voronoi_2 = Voronoi(Points=pop2d, Boundary=rec, BruteForceOverride=False)
box = Box({Plane=PlaneXY(0, 0, 0), X=Domain(0, 50), Y=Domain(0, 50), Z=Domain(0, 50)})
pop3d = Populate3D(Region=box, Count=100, Seed=1)
voronoi³ = Voronoi3D(Points=pop3d, Box=box)  # -> Cells, Boundary
