# Grasshopper definition hex-shapes.gh (Grasshopper 1.0.7)

# The X Size is the width of your cardboard. Increase or decrease the value to account for variance in size.
number_slider = Slider(3.5, range=0..10)
number_slider_2 = Slider(21, range=0..100)
# ASSEMBLE THE SHAPES
# 
# Set the dimensions for all outputs, then bake the Radial Grid, Rectangle and Cylinder.
# 
# Use the Rectangle to cut slots in the complex shape and the cylinder.
# 
# These slots will be where cardboard pieces connect to each other.
rectangle = Rectangle(Plane=PlaneXY(0, 0, 0), XSize=number_slider, YSize=number_slider_2, Radius=0)  # -> Rectangle, Length
# Use the Radial Grid to form the complex shape.
# 
# The Size will change the size of the shape.
# 
# Extent R will change the cell count from the center.
# 
# Extent P will change the number of sides that are being formed.
radgrid = Radial(Plane=PlaneXY(0, 0, 0), Size=Slider(10.5, range=0..100), ExtentR=Slider(5, range=0..10), ExtentP=Slider(7, range=0..10))  # -> Cells, Points
# I created a cylinder to make blank circle pieces to test fit and connect different complex shapes to each other.
# 
# The Length of 1 accounts for the 1 mm height that I've set the height of all of the 3d shapes in Rhino.
cyl = Cylinder(Base=PlaneXY(0, 0, 0), Radius=number_slider_2, Length=Slider(1, range=0..1))
